% Simulink data dictionary modelDictionary.sldd

BAK = Simulink.Signal(DataType="double")  % 0.00525
  % 0.012
  % 0.958
  % 0.1827
  % 0.012
  % 0.0525

Ts = 1.0e-6
MPTA_SubSysCtrl = 0
switch_electronic_feedworward = 1
DTC_Flux_Predict = 0
MPTA_Way = 1
SysCurrentMax = 50
SysSpeedMax = 2500
Switch_Sensorless_Algo = 1
Motor_J = 0.008
Motor_Rs = 0.33
Motor_Ld_Indctances = 0.0052
SysVoltage = 311
Motor_flux = 0.646
Motor_Pn = 2
Motor_B = 0.008
Switch_SubsysCtrl = 6
Motor_Lq_Indctances = 0.0174